# Grasshopper definition Assignment 2 - polygon.gh (Grasshopper 1.0.7)

height_of_rectangle = Slider(12, range=0..100)
width_of_cut = Slider(2.5, range=0..100)
radius_of_polygon = Slider(25, range=0..100)
number_of_sides = Slider(4, range=0..10)
rectangle = Rectangle(Plane=PlaneXY(0, 0, 0), XSize=width_of_cut, YSize=height_of_rectangle, Radius=0)  # -> Rectangle, Length
number = Number(-2)
subtraction = Subtraction(A=radius_of_polygon, B=height_of_rectangle)
division = Division(A=width_of_cut, B=number)
vector_xyz = VectorXYZ(XComponent=division, YComponent=subtraction, ZComponent=0)  # -> Vector, Length
number_of_cuts = Slider(6, range=0..100)
move = Move(Geometry=rectangle.Rectangle, Motion=vector_xyz.Vector)  # -> Geometry, Transform
polygon = Polygon(Plane=PlaneXY(0, 0, 0), Radius=radius_of_polygon, Segments=number_of_sides, FilletRadius=5)  # -> Polygon, Length
polar_array = PolarArray(Geometry=move.Geometry, Plane=PlaneXY(0, 0, 0), Count=number_of_cuts, Angle=6.283185307)  # -> Geometry, Transform
trim_with_regions = TrimWithRegions(Curve=polar_array.Geometry, Regions=polygon.Polygon)  # -> flatten(Inside), Outside
trim_with_regions_2 = TrimWithRegions(Curve=polygon.Polygon, Regions=polar_array.Geometry)  # -> Inside, Outside
join_curves = JoinCurves(Curves=[trim_with_regions.Inside, trim_with_regions_2.Outside], Preserve=False)
